vi "index.gviweb"   [LabVIEW NXG 5.1.0]
panel controls:
  "Subscribe to watch battery": bool
  "Subscribe to Accelerometer": bool
panel indicators:
  "Battery Value": string
  "Chart": waveform<f64>[]
uses:
  WebApp::SendCommand.gvi
  WebApp::Library.jsli::Eval
  WebApp::Library.jsli::String
diagram:
  while {
    event {
      on "Subscribe to watch battery" Value changed {
        w1 = """window.addEventListener("batterystatus", onBatteryStatus, false); 

function onBatteryStatus(status) { 
   ref.executeScript({ code: "var BatteryValue = " + status.level });
}"""
        call "SendCommand.gvi"(To Send Command=w1)
      }
      on "Subscribe to Accelerometer" Value changed {
        w2 = """function onSuccess(acceleration) {
    ref.executeScript({ code: 
        "var AccelerationX= " + acceleration.x + ";" +
        "AccelerationY= " + acceleration.y + ";" +
        "AccelerationZ= " + acceleration.z + ";" +
        "AccelerationTimestamp= " + acceleration.timestamp
    });
}

function onError() {
    alert('onError!');
}

var options = { frequency: 50};  // Update at 20hz -> 50ms

var watchID = navigator.accelerometer.watchAcceleration(onSuccess, onError, options);
"""
        call "SendCommand.gvi"(To Send Command=w2)
      }
    }
    stop if FALSE
  }
  while {
    # Keep on monitoring the BatteryValue variable
    call "Eval"(evalString="BatteryValue") -> (return=w3, error out=w4)
    call "String"(arg=w3, error in=w4) -> (return=w5)
    $"Battery Value" <- w5
    Wait(time to wait=50)
    for {
      w6 = each element of ["AccelerationX", "AccelerationY", "AccelerationZ"]
      call "Eval"(evalString=w6) -> (return=w8, error out=w9)
      call "String"(arg=w8, error in=w9) -> (return=w10)
      Floating Point String To Number(string=w10) -> (number=w11)
      Build Array(w11) -> w12
      call "Eval"(evalString="AccelerationTimestamp") -> (return=w13, error out=w14)
      call "String"(arg=w13, error in=w14) -> (return=w15)
      Floating Point String To Number(string=w15) -> (number=w16)
      Divide(x=w16, y=1000) -> w17
      To Timestamp(number=w17) -> w18
      Build Waveform Node(Y=w12, dt=0.001, t0=w18) -> (output waveform=w19)
      append w19 to w7
    }
    $Chart <- w7
    stop if FALSE
  }
